# Grasshopper definition messy_canvas.gh (Grasshopper 1.0.8)

addition = Addition(A=Slider(0.25, range=0..1), B=Slider(0.25, range=0..1))
subtraction = Subtraction(A=Slider(0.25, range=0..1), B=addition)
multiplication = Multiplication(A=Slider(0.25, range=0..1), B=subtraction)
number_slider = Slider(0.25, range=0..1)
pt = ConstructPoint(XCoordinate=Slider(0.25, range=0..1), YCoordinate=Slider(0.25, range=0..1), ZCoordinate=number_slider)
addition_2 = Addition(A=Slider(0.25, range=0..1), B=number_slider)
division = Division(A=Slider(0.25, range=0..1), B=Slider(0.25, range=0..1))
addition_3 = Addition(A=division, B=Slider(0.25, range=0..1))
