# Grasshopper definition simple_migration.gh (Grasshopper 1.0.8)

addition = Addition(A=Slider(0.25, range=0..1), B=Slider(0.25, range=0..1))
panel = Panel(addition)
pt = ConstructPoint(XCoordinate=Slider(0.25, range=0..1), YCoordinate=Slider(0.25, range=0..1), ZCoordinate=Slider(0.25, range=0..1))
